# Grasshopper definition 3DMazeGen.gh (Grasshopper 1.0.7)

display_3d_maze_geometry_slow = BooleanToggle(False)
display_real_time_maze_path = BooleanToggle(True)
maze_size = Slider(3.5, range=1..5)
no_of_rows = Slider(10, range=5..25)
no_of_layers = Slider(10, range=5..25)
no_of_cols = Slider(10, range=5..25)
generate_reset_maze = BooleanToggle(False)
trigger = Trigger(Interval=10, TimerInterval=10, Target=c_script)  # disabled
c_script = CSharpScript(
    width=maze_size,
    rows=no_of_rows,
    cols=no_of_cols,
    layers=no_of_layers,
    generate=generate_reset_maze,
    showMaze=display_3d_maze_geometry_slow,
    showPath=display_real_time_maze_path)  # -> out, maze, marker, mazePath; inputs width: Double, rows: Int32, cols: Int32, layers: Int32, generate: Boolean, showMaze: Boolean, showPath: Boolean
# ---------- c_script: C# ----------
    if(!generate){
      grid = createGrid(rows, cols, layers, width);
      current = grid[0];
      cellStack = new Stack<Cell>();
      path = new DataTree<Point3d>();
      pathCount = 0;
    } else {
      if(showMaze) {
        //Showing the grid
        List<Brep> gridGeo = new List<Brep>();
        for(int i = 0; i < grid.Count; i++) {
          gridGeo.AddRange(grid[i].show());
        }
        maze = gridGeo;
      }
      current.visited = true;
      marker = current.highlight();

      //Recursive backtracking algorithm
      Cell next = current.checkNeighbors(grid);

      if(!(next == null)) {
        next.visited = true;
        cellStack.Push(current);
        removeWalls(current, next);
        current = next;
        GH_Path pth = new GH_Path(pathCount);
        path.Add(new Point3d((double) current.i * width, (double) current.j * width, (double) current.k * width), pth);

      } else if(cellStack.Count > 0) {
        current = cellStack.Pop();
        pathCount++;

      }
      if(showPath) {
        mazePath = path;
      }

    }
# ---------- c_script: C# additional code ----------
  //Global variables
  List<Cell> grid;
  Cell current;
  Stack<Cell> cellStack;
  DataTree<Point3d> path;
  int pathCount;

  public class Cell
  {
    public int i, j, k, rows, cols, layers;
    public double w, x, y, z;
    public bool[] walls = {true, true, true, true, true, true};
    public bool visited = false;

    //Constructor
    public Cell(int i, int j, int k, double w, int rows, int cols, int layers)
    {
      this.i = i;
      this.j = j;
      this.k = k;
      this.w = w;
      this.rows = rows;
      this.cols = cols;
      this.layers = layers;
    }

    public Cell checkNeighbors(List<Cell> grid)
    {
      List<Cell> neighbors = new List<Cell>();
      Cell top, bottom, left, right, up, down;

      if(this.j < this.rows - 1) {
        top = grid[this.index(this.i, this.j + 1, this.k)];
      } else {
        top = null;
      }
      if(this.i < this.cols - 1) {
        right = grid[this.index(this.i + 1, this.j, this.k)];
      } else {
        right = null;
      }
      if(this.j > 0) {
        bottom = grid[this.index(this.i, this.j - 1, this.k)];
      } else {
        bottom = null;
      }
      if(this.i > 0) {
        left = grid[this.index(this.i - 1, this.j, this.k)];
      } else {
        left = null;
      }
      if(this.k < this.layers - 1) {
        up = grid[this.index(this.i, this.j, this.k + 1)];
      } else {
        up = null;
      }
      if(this.k > 0) {
        down = grid[this.index(this.i, this.j, this.k - 1)];
      } else {
        down = null;
      }

      if (!(top == null) && !top.visited) {
        neighbors.Add(top);
      }
      if (!(right == null) && !right.visited) {
        neighbors.Add(right);
      }
      if (!(bottom == null) && !bottom.visited) {
        neighbors.Add(bottom);
      }
      if (!(left == null) && !left.visited) {
        neighbors.Add(left);
      }
      if (!(up == null) && !up.visited) {
        neighbors.Add(up);
      }
      if (!(down == null) && !down.visited) {
        neighbors.Add(down);
      }

      if (neighbors.Count > 0) {
        int index = new Random().Next(neighbors.Count);
        return neighbors[index];
      } else {
        return null;
      }
    }

    public Box highlight()
    {
      this.x = (double) this.i * this.w;
      this.y = (double) this.j * this.w;
      this.z = (double) this.k * this.w;

      Interval wInterval = new Interval(-this.w / 2.0, this.w / 2.0);
      Vector3d normal = new Vector3d(0, 0, 1);
      Plane p = new Plane(new Point3d(this.x, this.y, this.z), normal);
      Box highlightBox = new Box(p, wInterval, wInterval, wInterval);
      return highlightBox;
    }

    public int index(int i, int j, int k)
    {
      return (k * rows * cols) + (j * cols) + i;
    }

    public List<Brep> show()
    {
      this.x = (double) this.i * this.w;
      this.y = (double) this.j * this.w;
      this.z = (double) this.k * this.w;

      List<Brep> wallBrep = new List<Brep>();

      if (this.walls[0]) {
        wallBrep.Add(Brep.CreateFromCornerPoints(
          new Point3d(this.x - (this.w / 2.0), this.y - (this.w / 2.0), this.z + (this.w / 2.0)),
          new Point3d(this.x - (this.w / 2.0), this.y + (this.w / 2.0), this.z + (this.w / 2.0)),
          new Point3d(this.x - (this.w / 2.0), this.y + (this.w / 2.0), this.z - (this.w / 2.0)),
          new Point3d(this.x - (this.w / 2.0), this.y - (this.w / 2.0), this.z - (this.w / 2.0)), 0.01
          ));
      }
      if (this.walls[1]) {
        wallBrep.Add(Brep.CreateFromCornerPoints(
          new Point3d(this.x + (this.w / 2.0), this.y - (this.w / 2.0), this.z + (this.w / 2.0)),
          new Point3d(this.x + (this.w / 2.0), this.y + (this.w / 2.0), this.z + (this.w / 2.0)),
          new Point3d(this.x + (this.w / 2.0), this.y + (this.w / 2.0), this.z - (this.w / 2.0)),
          new Point3d(this.x + (this.w / 2.0), this.y - (this.w / 2.0), this.z - (this.w / 2.0)), 0.01
          ));
      }
      if (this.walls[2]) {
        wallBrep.Add(Brep.CreateFromCornerPoints(
          new Point3d(this.x + (this.w / 2.0), this.y - (this.w / 2.0), this.z + (this.w / 2.0)),
          new Point3d(this.x - (this.w / 2.0), this.y - (this.w / 2.0), this.z + (this.w / 2.0)),
          new Point3d(this.x - (this.w / 2.0), this.y - (this.w / 2.0), this.z - (this.w / 2.0)),
          new Point3d(this.x + (this.w / 2.0), this.y - (this.w / 2.0), this.z - (this.w / 2.0)), 0.01
          ));
      }
      if (this.walls[3]) {
        wallBrep.Add(Brep.CreateFromCornerPoints(
          new Point3d(this.x + (this.w / 2.0), this.y + (this.w / 2.0), this.z + (this.w / 2.0)),
          new Point3d(this.x - (this.w / 2.0), this.y + (this.w / 2.0), this.z + (this.w / 2.0)),
          new Point3d(this.x - (this.w / 2.0), this.y + (this.w / 2.0), this.z - (this.w / 2.0)),
          new Point3d(this.x + (this.w / 2.0), this.y + (this.w / 2.0), this.z - (this.w / 2.0)), 0.01
          ));
      }
      if (this.walls[4]) {
        wallBrep.Add(Brep.CreateFromCornerPoints(
          new Point3d(this.x - (this.w / 2.0), this.y - (this.w / 2.0), this.z + (this.w / 2.0)),
          new Point3d(this.x - (this.w / 2.0), this.y + (this.w / 2.0), this.z + (this.w / 2.0)),
          new Point3d(this.x + (this.w / 2.0), this.y + (this.w / 2.0), this.z + (this.w / 2.0)),
          new Point3d(this.x + (this.w / 2.0), this.y - (this.w / 2.0), this.z + (this.w / 2.0)), 0.01
          ));
      }
      if (this.walls[5]) {
        wallBrep.Add(Brep.CreateFromCornerPoints(
          new Point3d(this.x - (this.w / 2.0), this.y - (this.w / 2.0), this.z - (this.w / 2.0)),
          new Point3d(this.x - (this.w / 2.0), this.y + (this.w / 2.0), this.z - (this.w / 2.0)),
          new Point3d(this.x + (this.w / 2.0), this.y + (this.w / 2.0), this.z - (this.w / 2.0)),
          new Point3d(this.x + (this.w / 2.0), this.y - (this.w / 2.0), this.z - (this.w / 2.0)), 0.01
          ));
      }

      if (wallBrep.Count > 0) {
        return wallBrep;
      }
      return null;
    }
  }

  //Function that removes the wall between two input cells
  public void removeWalls(Cell a, Cell b)
  {
    int x = a.i - b.i;

    if (x == 1) {
      a.walls[0] = false;
      b.walls[1] = false;
    } else if (x == -1) {
      a.walls[1] = false;
      b.walls[0] = false;
    }

    int y = a.j - b.j;

    if (y == 1) {
      a.walls[2] = false;
      b.walls[3] = false;
    } else if (y == -1) {
      a.walls[3] = false;
      b.walls[2] = false;
    }

    int z = a.k - b.k;

    if (z == 1) {
      a.walls[5] = false;
      b.walls[4] = false;
    } else if (z == -1) {
      a.walls[4] = false;
      b.walls[5] = false;
    }
  }
  public List<Cell> createGrid(int rows, int cols, int layers, double width)
  {
    List<Cell> grid = new List<Cell>();
    //Creating grid of cells
    for(int k = 0; k < layers; k++) {
      for(int j = 0; j < rows; j++) {
        for(int i = 0; i < cols; i++) {
          Cell node = new Cell(i, j, k, width, rows, cols, layers);
          grid.Add(node);
        }
      }
    }
    return grid;
  }
# ---------- end c_script ----------
preview = CustomPreview(Geometry=c_script.maze, Material=ColourSwatch(SwatchColor=RGBA(128, 128, 128, 10)))
preview_2 = CustomPreview(Geometry=c_script.marker, Material=ColourSwatch(SwatchColor=RGB(111, 212, 229)))
cullpt = CullDuplicates(Points=c_script.mazePath, Tolerance=0.1, CullMode=3)  # -> Points, Indices, Valence
prune = PruneTree(Tree=cullpt.Points, Minimum=2, Maximum=0)
pline = PolyLine(Vertices=prune, Closed=False)
preview_3 = CustomPreview(Geometry=pline, Material=ColourSwatch(SwatchColor=RGB(230, 221, 69)))
